# Grasshopper definition Coordonnes_normale_surface.gh (Grasshopper 1.0.7)
# plug-ins: TT Toolbox, FalseStartToggle, Pancake, treesloth01

# ----
# 04/2020
# 
# Ce code permet d'obtenir les normales et tangentes au surface.
# Il a été développé dans le but principal d'obtenir ces valeursp pour VisualCFD (OpenFoam), lors de la modélisation de grilles de modélisation.
# Ces étapes sont nécéssaires d'être réalisées par l'utilisateur :
# 
# - Nommer ses surfaces, afin de mieux se repérer, à la fois dans son modèle 3D et également dans l'Excel qui sera généré.
# 
# - Ouvrir un Excel vierge dans lequel le code viendra copier les valeurs obtenues.
# 1
# Séléctionner la/les surface(s) pour la(les)quelles
#  les informations sont demandées.
brep = Brep(<brep referenced from the Rhino model>)

deplane = DeconstructPlane(Plane=brep)  # -> Origin, XAxis, YAxis, ZAxis

# ----
# Centroid du plan.
# 
# Les composantes X et Y sont d'utilité pour ParaView quand le plan n'a pas de z constant.
area = Area(Geometry=brep)  # -> Area, Centroid
devec = DeconstructVector(Vector=area.Centroid)  # -> XComponent, YComponent, ZComponent
stack = StackTrees(Data0=devec.XComponent, Data1=devec.YComponent, Reduce=True)
stack_2 = StackTrees(Data0=stack, Data1=devec.ZComponent, Reduce=True)

# ----
# Normale
devec_2 = DeconstructVector(Vector=deplane.ZAxis)  # -> XComponent, YComponent, ZComponent
stack_3 = StackTrees(Data0=devec_2.XComponent, Data1=devec_2.YComponent, Reduce=True)
stack_4 = StackTrees(Data0=stack_3, Data1=devec_2.ZComponent, Reduce=True)

# ----
# Noms des lignes. N = Normale et T = Tangente
yn = Text("YN")
xn = Text("XN")
zn = Text("ZN")
xc = Text("XC")
yc = Text("YC")
zc = Text("ZC")
merge = Merge(Data1=xn, Data2=yn, Data3=zn, Data5=xc, Data6=yc, Data7=zc)

# ----
# Récupération des noms des surfaces
objdet = ObjectDetails(Object=brep)  # -> Referenced, Available, Name, Layer, Colour, Guid

stack_5 = StackTrees(Data0=stack_4, Data1=stack_2, Reduce=True)
panel = Panel(objdet.Name)

# ----
# Nom de l'onglet d'Excel. Peut être changé si souhaité.
coordonnees_totales = Text("Coordonnees_totales")

# ----
# Pour avoir une présentation cohérente,
# il faut que ce soit "TRUE".
toggle = FalseStartToggle(True)

# ----
# 2
# Appuyer sur le bouton pour lancer
# l'écriture des données dans l'Excel ouvert.
truebutton = TrueOnlyButton(LastSaveLocalization="neutral,N")

writexl = WriteToExcel(
    Run=truebutton,
    ExcelWorksheet=coordonnees_totales,
    ColumnNames=objdet.Name,
    RowNames=merge,
    WriteOptions="None",
    ColumnnsOrRows=toggle,
    DataToWriteIntoColumns=stack_5)
